# Grasshopper definition ashrimal_A1.gh (Grasshopper 1.0.7)

md_slider = MDSlider(
    SliderMode=0,
    slider_value=Point(0.568747032, 0.8180393126, 0.5),
    x_domain=Domain(0, 1),
    y_domain=Domain(0, 1),
    z_domain=Domain(0, 1))
crv = Curve(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)
S = Surface(crv)
divide = DivideDomain²(Domain=S, UCount=Slider(6, range=3..12), VCount=Slider(10, range=3..12))
evalsrf = EvaluateSurface(Surface=reparameterize(S), Point=md_slider)  # -> Point, Normal, UDirection, VDirection, Frame
vec = Vector(expr("-x", crv))
subsrf = Isotrim(Surface=S, Domain=divide)
multiplication = Multiplication(A=vec, B=Slider(163.68, range=0..300))
pcen = PolygonCenter(Polyline=subsrf)  # -> CenterV, CenterE, CenterA
crv_2 = Curve(subsrf)
max_scale = Slider(0.8, range=0.1..0.9)
min_scale = Slider(0.1, range=0.1..0.9)
move = Move(Geometry=crv, Motion=multiplication)  # -> Geometry, Transform
cp = ClosestPoint(Point=pcen.CenterV, Cloud=evalsrf.Point)  # -> ClosestPoint, CPIndex, Distance
srf = Surface(move.Geometry)
extr = Extrude(Base=crv, Direction=multiplication)
bnd = Bounds(Numbers=cp.Distance)
dom = ConstructDomain(DomainStart=min_scale, DomainEnd=max_scale)
join = BrepJoin(Breps=flatten([srf, extr]))  # -> Breps, Closed
remap = RemapNumbers(Value=cp.Distance, Source=bnd, Target=Domain(0, 1))  # -> Mapped, Clipped
edges = BrepEdges(Brep=join.Breps)  # -> Naked, Interior, NonManifold
remap_2 = RemapNumbers(Value=remap.Mapped, Source=Domain(0, 1), Target=dom)  # -> Mapped, Clipped
scale = Scale(Geometry=crv_2, Center=pcen.CenterV, Factor=remap_2.Mapped)  # -> Geometry, Transform
crv_3 = Curve(scale.Geometry)
crv_4 = Curve(crv_2)
disc = Discontinuity(Curve=crv_4, Level=1)  # -> Points, Parameters
disc_2 = Discontinuity(Curve=crv_3, Level=1)  # -> Points, Parameters
shift = ShiftList(List=disc_2.Points, Shift=1, Wrap=True)
pt = Point(disc.Points)
pt_2 = Point(shift)
rec_2pt = Rectangle2Pt(Plane=crv, PointA=pt, PointB=pt_2, Radius=0)  # -> Rectangle, Length
srf_2 = Surface(simplify(rec_2pt.Rectangle))
srf_3 = Surface(simplify(graft(scale.Geometry)))
preview = CustomPreview(Geometry=srf_3, Material=ColourSwatch(SwatchColor=RGBA(139, 18, 255, 109)))
preview_2 = CustomPreview(Geometry=srf_2, Material=ColourSwatch(SwatchColor=RGB(112, 0, 0)))
