# Grasshopper definition ashrimal_A2 01.gh (Grasshopper 1.0.7)

number_slider = Slider(7, range=0..10)
number_slider_2 = Slider(32, range=0..100)
rectangle = Rectangle(Plane=PlaneXY(0, 0, 0), XSize=Slider(5, range=0..10), YSize=number_slider_2, Radius=0)  # -> Rectangle, Length
rectangle_2 = Rectangle(Plane=PlaneXY(0, 0, 0), XSize=number_slider, YSize=number_slider_2, Radius=0)  # -> Rectangle, Length
addition = Addition(A=number_slider, B=Slider(24, range=0..100))
box_rectangle = BoxRectangle(Rectangle=rectangle.Rectangle, Height=Slider(7, range=0..10))
box_rectangle_2 = BoxRectangle(Rectangle=rectangle_2.Rectangle, Height=Slider(7, range=0..10))
unit_x = UnitX(Factor=addition)
move = Move(Geometry=box_rectangle_2, Motion=unit_x)  # -> Geometry, Transform
brep_edges = BrepEdges(Brep=box_rectangle)  # -> Naked, Interior, NonManifold
brep_edges_2 = BrepEdges(Brep=move.Geometry)  # -> Naked, Interior, NonManifold
list_item = ListItem(List=brep_edges.Interior, Index=Slider(5, range=0..10), Wrap=True)
line = Line(list_item)
curve = Curve(line)
list_item_2 = ListItem(List=brep_edges_2.Interior, Index=Slider(7, range=0..10), Wrap=True)
number_slider_3 = Slider(7, range=0..25)
line_2 = Line(list_item_2)
curve_2 = Curve(line_2)
divide_curve = DivideCurve(Curve=curve_2, Count=number_slider_3, Kinks=False)  # -> reverse(Points), Tangents, Parameters
divide_curve_2 = DivideCurve(Curve=curve, Count=number_slider_3, Kinks=False)  # -> Points, Tangents, Parameters
distance = Distance(PointA=divide_curve_2.Points, PointB=divide_curve.Points)
line_3 = Line(StartPoint=divide_curve_2.Points, EndPoint=divide_curve.Points)  # -> graft(Line)
multiline = Line(line_3)
inputcrv_s = Line(multiline)
list_item_3 = ListItem(List=distance, Index=0, Wrap=True)
division = Division(A=list_item_3, B=Slider(4, range=0..10))
curve_frame = CurveFrame(Curve=reparameterize(inputcrv_s), Parameter=Slider(0.5, range=0..1))
end_points = EndPoints(Curve=inputcrv_s)  # -> Start, End
number_slider_4 = Slider(17, range=0..100)
deconstruct_plane = DeconstructPlane(Plane=curve_frame)  # -> Origin, XAxis, YAxis, ZAxis
point = Point(curve_frame)
amplitude = Amplitude(Vector=deconstruct_plane.ZAxis, Amplitude=division)
move_2 = Move(Geometry=point, Motion=amplitude)  # -> Geometry, Transform
divide_curve_3 = DivideCurve(Curve=inputcrv_s, Count=number_slider_4, Kinks=False)  # -> Points, Tangents, Parameters
weave = Weave(Pattern=[0, 1, 2], Stream0=end_points.Start, Stream1=move_2.Geometry, Stream2=end_points.End, NullGaps=False)
interpolate = Interpolate(Vertices=weave, Degree=3, Periodic=False, KnotStyle=1)  # -> Curve, Length, Domain
divide_curve_4 = DivideCurve(Curve=interpolate.Curve, Count=number_slider_4, Kinks=False)  # -> Points, Tangents, Parameters
shift_list = ShiftList(List=divide_curve_4.Points, Shift=Slider(1, range=0..10), Wrap=False)
shortest_list = ShortestList(ListListA=divide_curve_3.Points, ListListB=shift_list, TrimMode=2)  # -> ListListA, ListListB
line_4 = Line(StartPoint=divide_curve_3.Points, EndPoint=divide_curve_4.Points)
swp1 = Sweep1(Rail=curve, Sections=interpolate.Curve, Miter=1)
line_5 = Line(StartPoint=shortest_list.ListListA, EndPoint=shortest_list.ListListB)
join = JoinCurves(Curves=[line_4, line_5], Preserve=False)
sdivide = DivideSurface(Surface=swp1, UCount="4", VCount=number_slider_4)  # -> Points, Normals, Parameters
pipe = Pipe(Curve=[join, inputcrv_s, interpolate.Curve], Radius=Slider(0.1, range=0..0.5), Caps=0)
