# Grasshopper definition ashrimal_A3.gh (Grasshopper 1.0.7)

md_slider = MDSlider(
    SliderMode=0,
    slider_value=Point(0.4609141274, 0.3074607136, 0.5),
    x_domain=Domain(0, 1),
    y_domain=Domain(0, 1),
    z_domain=Domain(0, 1))
md_slider_2 = MDSlider(
    SliderMode=0,
    slider_value=Point(0.3178124592, 0.5111866139, 0.5),
    x_domain=Domain(0, 1),
    y_domain=Domain(0, 1),
    z_domain=Domain(0, 1))
xz_plane = XZPlane(Origin=Point(0, 0, 0))
number_slider = Slider(58, range=0..100)
plane_surface = PlaneSurface(Plane=xz_plane, XSize=Slider(59.62, range=0..100), YSize=Slider(29.76, range=0..100))
divide_surface = DivideSurface(Surface=plane_surface, UCount=number_slider, VCount=Slider(48, range=0..100))  # -> flatten(Points), Normals, Parameters
evaluate_surface = EvaluateSurface(Surface=reparameterize(plane_surface), Point=[md_slider, md_slider_2])  # -> Point, Normal, UDirection, VDirection, Frame
closest_point = ClosestPoint(Point=divide_surface.Points, Cloud=evaluate_surface.Point)  # -> ClosestPoint, CPIndex, Distance
remap = Remap(data=closest_point.Distance, min=0, max=1)
graph_mapper = GraphMapper(remap, x0=0, x1=1, y0=0, y1=1, container_name="Sine", Equation_px=[0, 0.3512281477], Equation_py=[0, 0.5366644263])
remap_2 = Remap(data=graph_mapper, min=Slider(6.67, range=0..100), max=Slider(0.76, range=0..10))
unit_y = UnitY(Factor=remap_2)
move = Move(Geometry=divide_surface.Points, Motion=unit_y)  # -> Geometry, Transform
surface_from_points = SurfaceFromPoints(Points=move.Geometry, UCount=expr("x+1", number_slider), Interpolate=False)
curve = Curve(plane_surface)
curve_2 = Curve(surface_from_points)
loft = Loft(Curves=[curve, curve_2], Options={Adjust=True, Closed=False, LoftEnds=0, LoftSimp=0, LoftType=0, Rebuild=10, Refit=0.01})
number_slider_2 = Slider(1.3, range=0..10)
unit_x = UnitX(Factor=1)
brep_join = BrepJoin(Breps=[loft, surface_from_points, plane_surface])  # -> Breps, Closed
contour = Contour(Shape=brep_join.Breps, Point=Point(0, 0, 0), Direction=unit_x, Distance=number_slider_2)
unit_x_2 = UnitX(Factor=number_slider_2)
surface = Surface(contour)
extrude = Extrude(Base=surface, Direction=unit_x_2)

# ==== cluster Remap: Remaps numbers
data = ClusterInput()
min = ClusterInput()
max = ClusterInput()
bnd = Bounds(Numbers=data)
dom = ConstructDomain(DomainStart=min, DomainEnd=max)
remap = RemapNumbers(Value=data, Source=bnd, Target=dom)  # -> Mapped, Clipped
R = ClusterOutput(remap.Mapped)
